# Grasshopper definition autoshatter.gh (Grasshopper 1.0.7)
# plug-ins: DSUtilities

pipeline = GeometryPipeline(
    GroupByLayer=False,
    GroupByType=False,
    IncludeHidden=True,
    IncludeLocked=True,
    LayerFilter="*Default",
    NameFilter="*",
    SublayerFiltering=True,
    TypeFilter=4)
crv = Curve(pipeline)
autoshatter = AutoShatter(Curves=crv, Tolerance=0.1)  # -> ShatteredCurves, ShatterPoints, AllCurves
pt = Point(autoshatter.ShatterPoints)
crv_2 = Curve(autoshatter.AllCurves)
